# Grasshopper definition mesh transformation with firefly.gh (Grasshopper 0.9.76)
# plug-ins: Firefly.Core

number_slider = Slider(20, range=0..100)
mesh_sphere = MeshSphere(Base=PlaneXY(0, 0, 0), Radius=10, UCount=number_slider, VCount=number_slider)
deconstruct_mesh = DeconstructMesh(Mesh=mesh_sphere)  # -> Vertices, Faces, Colours, Normals
ports_available = COMPortsAvailable()
amplitude = Slider(1.8, range=0..10)
frequency = Slider(5, range=0..5)
open_port = OpenClosePort(OpenClosePort=Toggle(True), PortNumber=ports_available, BaudRate=115200)
timer = Timer(TimerInterval=100, Target=uno_read)
deconstruct = Deconstruct(Point=deconstruct_mesh.Vertices)  # -> XComponent, YComponent, ZComponent
panel = Panel(open_port)
uno_read = UnoRead(StartReadingValues=Toggle(True), PortNumber=ports_available)  # -> AnalogPin0, AnalogPin1, AnalogPin2, AnalogPin3, AnalogPin4, AnalogPin5, DigitalPin2, DigitalPin4, DigitalPin7, StatusMessage
dom = ConstructDomain(DomainStart=Slider(2, range=-2..3), DomainEnd=Slider(20, range=0..100))
dom_2 = ConstructDomain(DomainStart=0, DomainEnd=Slider(5, range=0..10))
expression = Expression(x=deconstruct.ZComponent, A=amplitude, f=frequency, Expression="A*sin(x*f/π)")
remap = RemapNumbers(Value=uno_read.AnalogPin0, Source=dom, Target=dom_2)  # -> Mapped, Clipped
panel_2 = Panel(uno_read.AnalogPin0)
panel_3 = Panel(remap.Mapped)
multiplication = Multiplication(A=deconstruct_mesh.Normals, B=expression)
move = Move(Geometry=deconstruct_mesh.Vertices, Motion=multiplication)  # -> Geometry, Transform
number_slider_2 = Slider(1, range=0..1)
gradient = Gradient(
    LowerLimit=0,
    UpperLimit=1,
    Parameter=expression,
    stops=[0: RGB(234, 38, 0), 0.25: RGB(234, 126, 0), 0.5: RGB(254, 244, 84), 0.75: RGB(173, 203, 249), 1: RGB(75, 107, 169)])
construct_mesh = ConstructMesh(Vertices=move.Geometry, Faces=deconstruct_mesh.Faces)
vector_xyz = VectorXYZ(XComponent=number_slider_2, YComponent=0, ZComponent=number_slider_2)  # -> Vector, Length
deconstruct_mesh_2 = DeconstructMesh(Mesh=construct_mesh)  # -> Vertices, Faces, Colours, Normals
mesh_colours = MeshColours(Mesh=construct_mesh, Colours=gradient)
angle = Angle(VectorA=deconstruct_mesh_2.Normals, VectorB=vector_xyz.Vector)  # -> Angle, Reflex
gradient_2 = Gradient(LowerLimit=0, UpperLimit=1, Parameter=angle.Angle, stops=[0: RGB(0, 0, 0), 1: RGB(192, 192, 192)])
mesh_colours_2 = MeshColours(Mesh=construct_mesh, Colours=gradient_2)
blur_mesh = BlurMesh(Mesh=mesh_colours_2, Iterations=Slider(53, range=0..100))
